# Dynamo graph VT_CorrectionsToDynamo.dyn (Dynamo 0.9.0.3072)

# group: Representation of: Wobj O-frame (block)
code_block = CodeBlock { CoordinateSystem.ByOrigin(0,0,0); }

# group: Representation of: Block on end effector
code_block_2 = CodeBlock { 0.4; }
byLengths = Cuboid.ByLengths(code_block, code_block_2, code_block_2, code_block_2)

# group: Representation of: Wobj U-Frames (drill along z-axis)
code_block_3 = CodeBlock()
# ---------- code_block_3.designscript (5 lines) ----------
CoordinateSystem.ByPlane(
 Plane.ByOriginNormalXAxis(
 Point.ByCoordinates(0,0,0),
 Vector.ByCoordinates(1,2,6),
 Vector.ByCoordinates(3,2,1)));
# ----------------------------------------
code_block_4 = CodeBlock()
# ---------- code_block_4.designscript (5 lines) ----------
CoordinateSystem.ByPlane(
 Plane.ByOriginNormalXAxis(
 Point.ByCoordinates(0,0,0),
 Vector.ByCoordinates(1,-7,6),
 Vector.ByCoordinates(3,2,1)));
# ----------------------------------------
code_block_5 = CodeBlock()
# ---------- code_block_5.designscript (5 lines) ----------
CoordinateSystem.ByPlane(
 Plane.ByOriginNormalXAxis(
 Point.ByCoordinates(0,0,0),
 Vector.ByCoordinates(-3,-2,6),
 Vector.ByCoordinates(3,6,3)));
# ----------------------------------------
code_block_6 = CodeBlock()
# ---------- code_block_6.designscript (5 lines) ----------
CoordinateSystem.ByPlane(
 Plane.ByOriginNormalXAxis(
 Point.ByCoordinates(0,0,0),
 Vector.ByCoordinates(-3,-2,6),
 Vector.ByCoordinates(-3,-3,3)));
# ----------------------------------------

create = List.Create(code_block_3, code_block_4, code_block_5, code_block_6)

# group: Sample struts
origin = CoordinateSystem.Origin(create)
ZAxis = CoordinateSystem.ZAxis(create)
byStartPointDirectionLength = Line.ByStartPointDirectionLength(startPoint=origin, direction=ZAxis)

# group: Sample node
origin_2 = CoordinateSystem.Origin(code_block)

# group: Get struts that intersect with node and orient to point as necessary.
getLinesAtPoint = Dynamo_TORO.WIP_ROBARCH.getLinesAtPoint(byStartPointDirectionLength, origin_2)

planeAtParameter = Curve.PlaneAtParameter(curve=getLinesAtPoint)

# group: Reorient axes, here reversing the ZAxis and retain XAxis
flip_Plane = Dynamo_TORO.WIP_ROBARCH.flip_Plane(planeAtParameter)

directory_path = Directory("C:\Users\Nick Cote\Desktop\TORO\ClassLibrary1\ClassLibrary1\extra")
string = StringInput("test")

# group: Sort planes by Z about pole
sortPolar_Plane = Dynamo_TORO.WIP_ROBARCH.sortPolar_Plane(planeAtParameter)

# group: Align planes to guide XAxis
alignByXAxis_Plane = Dynamo_TORO.WIP_ROBARCH.alignByXAxis_Plane(sortPolar_Plane)

blockFrame = CodeBlock()
# ---------- blockFrame.designscript (3 lines) ----------
Plane.ByOriginNormal(
 Point.ByCoordinates(0,0,150),
 Vector.ByCoordinates(0,0,1));
# ----------------------------------------
drillFrame = CodeBlock()
# ---------- drillFrame.designscript (3 lines) ----------
Plane.ByOriginNormal(
 Point.ByCoordinates(230,-50,280),
 Vector.ByCoordinates(0,0,-1));
# ----------------------------------------

# group: Create drilling routine
createDrillRoutine3 = Dynamo_TORO.WIP_ROBARCH.createDrillRoutine3(directory_path, string, alignByXAxis_Plane, blockFrame, drillFrame)
