# Dynamo graph example02.dyn (Dynamo 0.9.1.4054)

directory_path = Directory("C:\Users\Nick Cote\Desktop\TORO\ClassLibrary1\ClassLibrary1\extra\directory")
code_block = CodeBlock { 100; }
byLengths = Cuboid.ByLengths(width=code_block, length=code_block, height=code_block)
edges = Face.Edges(byLengths)
curveGeometry = Edge.CurveGeometry(edges)
endPoint = Curve.EndPoint(curveGeometry)
startPoint = Curve.StartPoint(curveGeometry)
byStartPointEndPoint = Line.ByStartPointEndPoint(startPoint=endPoint, endPoint=startPoint)
code_block_2 = CodeBlock { 40; }
byLengths_2 = Cuboid.ByLengths(width=code_block_2, length=code_block_2, height=code_block_2)
byPointsLinesGeometries = WireFrameToRobot.Node.ByPointsLinesGeometries(endPoint, byStartPointEndPoint, byLengths_2)
testAngular1_Node = Dynamo_TORO.WIP_ROBARCH.testAngular1_Node(byPointsLinesGeometries)
testAngular2_Node = Dynamo_TORO.WIP_ROBARCH.testAngular2_Node(testAngular1_Node)
createDrillRoutine3 = Dynamo_TORO.WIP_ROBARCH.createDrillRoutine3(directory_path, testAngular2_Node)
struts = WireFrameToRobot.Node.Struts(testAngular2_Node)
code_block_3 = CodeBlock { Vector.ByCoordinates(0,1,0); }
transformedAndAlignedCutPlaneUsingMarchi = WireFrameToRobot.Strut.TransformedAndAlignedCutPlaneUsingMarching(struts, code_block_3)
i = DoubleSlider(3, range=0..10 step 1)
code_block_4 = CodeBlock(l=transformedAndAlignedCutPlaneUsingMarchi, i=i) { l[0][i]; }
byPlane = CoordinateSystem.ByPlane(code_block_4)
j = DoubleSlider(0, range=0..2 step 1)
code_block_5 = CodeBlock(l=byPlane, j=j) { l[j]; }
code_block_6 = CodeBlock { true; }
flip_Plane = Dynamo_TORO.WIP_ROBARCH.flip_Plane(code_block_4, code_block_6)
code_block_7 = CodeBlock()
# ---------- code_block_7.designscript (5 lines) ----------
Plane.ByOriginNormalXAxis(
 Point.ByCoordinates(330,-260,280),
 Vector.ByCoordinates(0,0,1),
 Vector.ByCoordinates(-1,0,0)
 );
# ----------------------------------------
number_slider = DoubleSlider(139, range=-180..180 step 0.1)
rotate = Geometry.Rotate(code_block_7, code_block_7, number_slider)
byPlane_2 = CoordinateSystem.ByPlane(rotate)
quatListAtPlane = Dynamo_TORO.Utilities.QuatListAtPlane(rotate)
