# Dynamo graph SimpleOptimization.dyn (Dynamo 0.9.2.4472)

# group: Inputs for Node Strut Model
code_block = CodeBlock { 6; }
averageStrutsVector = WireFrameToRobot.OrientationStrategy.AverageStrutsVector()
code_block_2 = CodeBlock { 20; }
byLengths = Cuboid.ByLengths(width=code_block_2, length=code_block_2, height=code_block_2)

# group: Scale Factor For Diameters
code_block_3 = CodeBlock { 0.8; }

# group: Create the cooling tower form
code_block_4 = CodeBlock { 1200; }
code_block_5 = CodeBlock(base=code_block_4) { baseh = base; bottomRing = 0; midh = baseh + base; toph = midh +baseh; }
code_block_6 = CodeBlock(base=code_block_4) { bottomRing = base * 1.5; mid = base / 1.2; top = mid * 1.1; }

create = List.Create(code_block_5.bottomRing, code_block_5.baseh, code_block_5.midh, code_block_5.toph)
byCoordinates = Point.ByCoordinates(z=create)
create_2 = List.Create(code_block_6.bottomRing, code_block_4, code_block_6.mid, code_block_6.top)

# group (continued): Create the cooling tower form
code_block_7 = CodeBlock(x=create_2, diameterScaleFactor=code_block_3) { x*diameterScaleFactor; }

byCenterPointRadius = Circle.ByCenterPointRadius(centerPoint=byCoordinates, radius=code_block_7)

# group (continued): Create the cooling tower form
byLoft = Surface.ByLoft(byCenterPointRadius)

# group: Bounds Info
boundingBox = Geometry.BoundingBox(byLoft)
toCuboid = BoundingBox.ToCuboid(boundingBox)

averageStrutsAlignToZExactly = WireFrameToRobot.OrientationStrategy.AverageStrutsAlignToZExactly()
averageStrutsVector_2 = WireFrameToRobot.OrientationStrategy.AverageStrutsVector()
averageStrutsFindTypes = WireFrameToRobot.OrientationStrategy.AverageStrutsFindTypes()
code_block_8 = CodeBlock()
# ---------- code_block_8.designscript (21 lines) ----------
def continueFunction(solution : StrutSolution, numFailing: var)
{
//cannot execute this function call inside
//the imperative code block...?
isNull = DSCore.Object.IsNull(solution);
return = [Imperative]
 {
 if(isNull)
 {
 //if the input is null break out of the while loop
 return = false;
 }
 else
 {
 //if the number of passing struts is low, keep
 //looping
 return = Count(solution.Failing) > numFailing;
 }

 };
};
# ----------------------------------------

# group: Tessellate
code_block_9 = CodeBlock { 8; }
code_block_10 = CodeBlock { 8; }
lunchbox_triangle_grid_by_face = Custom[LunchBox Triangle Grid by Face](Surface=byLoft, U=code_block_9, V=code_block_10)  # Create a Triangular XYZ grid on a face. The face surface must have an untrimmed UV parameter space.

# group: Get All Lines and Points that represent the form - There are duplicates in this list
code_block_11 = CodeBlock(lines=lunchbox_triangle_grid_by_face.Panel_Polys) { lines; }
explode = Geometry.Explode(code_block_11)
flatten = Flatten(explode)
startPoint = Curve.StartPoint(flatten)
endPoint = Curve.EndPoint(flatten)
byStartPointEndPoint = Line.ByStartPointEndPoint(startPoint=startPoint, endPoint=endPoint)

code_block_12 = CodeBlock { 38; }
byWidthLength = Rectangle.ByWidthLength(width=code_block_12, length=code_block_12)
averageStrutsAlignToStrut = WireFrameToRobot.OrientationStrategy.AverageStrutsAlignToStrut()
byPointsLinesAndGeoOrientationStrategy = WireFrameToRobot.Node.ByPointsLinesAndGeoOrientationStrategy(startPoint, byStartPointEndPoint, byWidthLength, byLengths, averageStrutsAlignToStrut)
findUniqueStruts = WireFrameToRobot.Node.FindUniqueStruts(byPointsLinesAndGeoOrientationStrategy)
code_block_13 = CodeBlock { 2500; }
byStrutForces = WireFrameToRobot.StrutUtilities.StrutLoadPackage.ByStrutForces(findUniqueStruts, code_block_13, code_block_13)
spruce = WireFrameToRobot.Material.Spruce()
ash = WireFrameToRobot.Material.Ash()
beech = WireFrameToRobot.Material.Beech()
birch = WireFrameToRobot.Material.Birch()
oak = WireFrameToRobot.Material.Oak()
create_3 = List.Create(ash, beech, birch, oak, spruce)
generateInitialSolutionByStrutsPackagesA = WireFrameToRobot.StrutUtilities.StrutMaterialEvaluator.GenerateInitialSolutionByStrutsPackagesAndMaterial(byStrutForces, spruce, create_3)
code_block_14 = CodeBlock { _SingleFunctionObject(continueFunction,2,{1},{null,5},true); }
generateNewSolution = WireFrameToRobot.StrutUtilities.StrutMaterialEvaluator.GenerateNewSolution()
loopWhile = LoopWhile(generateInitialSolutionByStrutsPackagesA, code_block_14, generateNewSolution)
strutLoadPackages = WireFrameToRobot.StrutUtilities.StrutSolution.StrutLoadPackages(loopWhile)
strut = WireFrameToRobot.StrutUtilities.StrutLoadPackage.Strut(strutLoadPackages)
material = WireFrameToRobot.Strut.Material(strut)
name = WireFrameToRobot.Material.Name(material)
